# Grasshopper definition Example_file.ghx (Grasshopper 1.0.7)

# ---- group: Executing the code remotely. Bringing and keeping the result using the rpc module and scriptcontext / Run!
button = Button()

# ---- group: Executing the code remotely. Bringing and keeping the result using the rpc module and scriptcontext
image_resource = ImageResource("C:\Users\HP\Documents\Adam\Pro\Education\Portfolio\Github_Project\Shape_Recognition\IMG.JPG")
panel = Panel(image_resource)
ghpython_script = GhPythonScript(path=image_resource, read=button)  # -> out, points
# ---------- ghpython_script: Python ----------
from compas.rpc import Proxy
import os
from scriptcontext import sticky
from compas.geometry import Polyline, Transformation, Scale, Frame, Vector, Polygon
import Rhino.Geometry as rg
from ghpythonlib.treehelpers import list_to_tree

#Define a unique id before using sticky
points_key = 'pts_{}'.format(str(ghenv.Component.InstanceGuid))

if points_key not in sticky:
    sticky[points_key] = None

#Running "Contours_By_Color" python file and save the result inside sticky
if read:
    canvas = ghenv.Component.OnPingDocument()
    folder_path =  os.path.abspath(os.path.dirname(canvas.FilePath))
    with Proxy('Contours_By_Color', path = folder_path) as cbc:
        sticky[points_key] = cbc.get_contours(path)


#Output for Artist to convert compas geometry into rhino geometry
pts = sticky[points_key]
points = [Polyline(points=p) for p in pts]
# ---------- end ghpython_script ----------

# ---- group: Transform the raw input into a closed shape
draw = Draw(cg=ghpython_script.points)  # -> simplify(rg)
#   port cg: The COMPAS geometry or datastructure to be drawn.
#   port rg: The Rhino geometry object.
# ---------- draw: Python ----------
"""
Draws COMPAS geometry in Grasshopper.
"""
from ghpythonlib.componentbase import executingcomponent as component

from compas.artists import Artist


class CompasToRhinoGeometry(component):
    def RunScript(self, cg):
        if not cg:
            return None

        return Artist(cg).draw()
# ---------- end draw ----------
number_slider = Slider(100, range=0..100)
fline = FitLine(Points=draw)
ext = ExtendCurve(Curve=fline, Type=0, Start=number_slider, End=number_slider)  # -> reparameterize(flatten(Curve))
mcx = MultipleCurves(Curves=ext)  # -> Points, IndexA, IndexB, ParamA, ParamB
merge = Merge(Data1=mcx.IndexA, Data2=mcx.IndexB)
merge_2 = Merge(Data1=mcx.ParamA, Data2=mcx.ParamB)
sort = SortList(Keys=merge, ValuesA=merge_2)  # -> Keys, ValuesA
partition = PartitionList(List=sort.ValuesA, Size=Slider(2, range=0..10))
shatter = Shatter(Curve=graft(ext), Parameters=partition)
len = Length(Curve=shatter)
sort_2 = SortList(Keys=len, ValuesA=shatter)  # -> Keys, ValuesA
item = ListItem(List=reverse(sort_2.ValuesA), Index=0, Wrap=True)
join = JoinCurves(Curves=flatten(item), Preserve=False)
area = Area(Geometry=join)  # -> Area, Centroid
pt = ConstructPoint(XCoordinate=0, YCoordinate=0, ZCoordinate=0)
vec2pt = Vector2Pt(PointA=area.Centroid, PointB=pt, Unitize=False)  # -> Vector, Length
move = Move(Geometry=join, Motion=vec2pt.Vector)  # -> Geometry, Transform

# ---- group: Transform the raw input into a closed shape / Show
crv = Curve(move.Geometry)
